# Grasshopper definition test_gypython - Copy.gh (Grasshopper 1.0.8)
# Copyright: Arup

pt = Point(Point(0, 0, 0))
python = GhPythonScript()  # -> out, a
# ---------- python: Python ----------
__author__ = "raiti"
__version__ = "2025.04.02"

import rhinoscriptsyntax as rs
print ("hello kopaa")
# ---------- end python ----------
panel = Panel(python.out)
tag = TextTag(Location=pt, Text=panel)
